# Grasshopper definition 3d Print Brep Base Tension Reducers.gh (Grasshopper 1.0.7)
# plug-ins: Pufferfish, LunchBox

# ---- group: INPUTS
input_gap_width = Slider(0.6, range=0..50)
input_brep = Brep(<brep referenced from the Rhino model>)
input_edge_offset = Slider(3, range=0..50)
input_pad_width = Slider(10, range=0..100)
input_gap_height = Slider(0.6, range=0..10)
minimum_cutter_volume_3 = Slider(0.8, range=0..50)

# ---- group: Test For Srf on Z 0 Plane
debrep = DeconstructBrep(Brep=input_brep)  # -> Faces, Edges, Vertices
area = Area(Geometry=debrep.Faces)  # -> Area, Centroid
pdecon = Deconstruct(Point=area.Centroid)  # -> XComponent, YComponent, ZComponent
sort = SortList(Keys=pdecon.ZComponent, ValuesA=debrep.Faces)  # -> Keys, ValuesA
equals = Equality(FirstNumber=sort.Keys, SecondNumber=Slider(0, range=0..100))  # -> Equality, Inequality
dispatch = Dispatch(List=sort.ValuesA, DispatchPattern=equals.Equality)  # -> ListA, ListB

# ----
edges = BrepEdges(Brep=dispatch.ListA)  # -> flatten(Naked), Interior, NonManifold
number_slider = Slider(2, range=0..10)
join = JoinCurves(Curves=edges.Naked, Preserve=False)
neg = Negative(Value=input_edge_offset)
offset = OffsetCurve(Curve=join, Distance=input_edge_offset, Plane=PlaneXY(0, 0, 0), Corners=number_slider)  # -> flatten(Curve)
area_2 = Area(Geometry=join)  # -> Area, Centroid
area_3 = Area(Geometry=offset)  # -> Area, Centroid
sort_2 = SortList(Keys=area_3.Area, ValuesA=offset)  # -> Keys, ValuesA
sort_3 = SortList(Keys=area_2.Area, ValuesA=join)  # -> Keys, ValuesA
cull_i = CullIndex(List=sort_2.ValuesA, Indices="-1", Wrap=True)
item = ListItem(List=sort_3.ValuesA, Index="-1", Wrap=True)
crv = Curve(item)
crv_2 = Curve(cull_i)
offset_2 = OffsetCurve(Curve=crv, Distance=neg, Plane=PlaneXY(0, 0, 0), Corners=number_slider)  # -> flatten(Curve)
area_4 = Area(Geometry=crv_2)  # -> Area, Centroid
incurves = PointInCurves(Point=area_4.Centroid, Curves=offset_2)  # -> Relationship, Index, Point
equals_2 = Equality(FirstNumber=Slider(0, range=0..100), SecondNumber=incurves.Relationship)  # -> Equality, Inequality
dispatch_2 = Dispatch(List=crv_2, DispatchPattern=equals_2.Equality)  # -> ListA, ListB
crv_3 = Curve(dispatch_2.ListA)
crv_4 = Curve(dispatch_2.ListB)
crv_5 = Curve(offset_2)

# ---- group: Generate User Input Grid
brec = BoundingRectangle(Geometry=flatten([crv_3, crv_4, crv_5]), Plane=PlaneXY(0, 0, 0), Axis=0, Slide=0, Union=True)  # -> Bounding, DimensionX, DimensionY
gap_height = Panel(input_gap_height)
gap_width = Panel(input_gap_width)
pad_width = Panel(input_pad_width)
division = Division(A=gap_width, B=Slider(2, range=0..10))
addition = Addition(A=division, B=pad_width)
offset_3 = OffsetCurve(Curve=brec.Bounding, Distance=input_edge_offset, Plane=PlaneXY(0, 0, 0), Corners=1)
division_2 = Division(A=brec.DimensionY, B=addition)
division_3 = Division(A=brec.DimensionX, B=addition)
area_5 = Area(Geometry=brec.Bounding)  # -> Area, flatten(Centroid)
pdecon_2 = Deconstruct(Point=area_5.Centroid)  # -> XComponent, YComponent, ZComponent
grid = GridStructure(Surface=offset_3, UDivisions=division_3, VDivisions=division_2)  # -> StructureLines, StructureNodes
addition_2 = Addition(A=pdecon_2.ZComponent, B=gap_height)
pt = ConstructPoint(XCoordinate=pdecon_2.XComponent, YCoordinate=pdecon_2.YComponent, ZCoordinate=addition_2)
pt_2 = ConstructPoint(XCoordinate=pdecon_2.XComponent, YCoordinate=pdecon_2.YComponent, ZCoordinate=pdecon_2.ZComponent)
crv_6 = Curve(grid.StructureLines)
ln = Line(StartPoint=pt_2, EndPoint=pt)
offcrv = OffsetCurve(Curve=crv_6, Distance=division, Plane=offset_3, BothSides=Toggle(True), Kinks=0, CapType=Slider(2, range=0..10))  # -> flatten(Offset)

# ---- group: Outer Solids
extrude = ExtrudeLinear(Profile=flatten(crv_5), OrientationP=brec.Bounding, Axis=ln)
cap = CapHoles(Brep=extrude)  # -> flatten(Brep)
sunion = SolidUnion(Breps=cap)

# ---- group: Inner Solids
extrude_2 = ExtrudeLinear(Profile=flatten(crv_3), OrientationP=brec.Bounding, Axis=ln)
cap_2 = CapHoles(Brep=extrude_2)  # -> flatten(Brep)
sunion_2 = SolidUnion(Breps=cap_2)

# ---- group: Outside Solid Cutters
extrude_3 = ExtrudeLinear(Profile=crv_4, OrientationP=brec.Bounding, Axis=ln)  # -> flatten(Extrusion)
cap_3 = CapHoles(Brep=extrude_3)  # -> flatten(Brep)
sunion_3 = SolidUnion(Breps=cap_3)

# ---- group: Solid Grid
extrude_4 = ExtrudeLinear(Profile=offcrv, OrientationP=brec.Bounding, Axis=ln)
cap_4 = CapHoles(Brep=extrude_4)
sunion_4 = SolidUnion(Breps=cap_4)

# ---- group: Interset Grid WIth Solids
sdiff = SolidDifference(BrepsA=sunion, BrepsB=sunion_3)
sint = SolidIntersection(BrepsA=[sdiff, sunion_2], BrepsB=sunion_4)
sunion_5 = SolidUnion(Breps=sint)

# ---- group: Remove Items Below Volume Threshold
min_cutter_volume_3 = Panel(minimum_cutter_volume_3)
volume = Volume(Geometry=sunion_5)  # -> Volume, Centroid
sort_4 = SortList(Keys=volume.Volume, ValuesA=sunion_5)  # -> Keys, ValuesA
larger = LargerThan(FirstNumber=volume.Volume, SecondNumber=min_cutter_volume_3)  # -> LargerThan, OrEqualTo
sorted_volumes_for_reference = Panel(sort_4.Keys)
cull = CullPattern(List=sunion_5, CullPattern=larger.LargerThan)

# ---- group: END
toggle = BooleanToggle(False)

# ---- group: END / Set TRUE and Run to Bake
lng = ListLength(List=cull)
number_slider_2 = Slider(1, range=0..100)
color = ColourSwatch(SwatchColor=RGB(0, 0, 0))
color_2 = ColourSwatch(SwatchColor=RGB(222, 82, 47))
series = Series(Start=number_slider_2, Step=number_slider_2, Count=lng)
concat = Concatenate(FragmentA=graft("Cutter"), FragmentB=series)
bake = ObjectBake(
    BakeToggle=toggle,
    GeometryObjects=cull,
    Layer="TensileStressReductionCutter",
    ObjectName=concat,
    ObjectColor=color_2,
    LayerColor=color)
